# Grasshopper definition Algorithm_AB.ghx (Grasshopper 0.9.76)

number_slider = Slider(10, range=0..10)  # disabled
number_slider_2 = Slider(0, range=0..10)  # disabled
number_slider_3 = Slider(50, range=0..100)  # disabled
number_slider_4 = Slider(21, range=0..100)  # disabled
number_slider_5 = Slider(15, range=0..100)  # disabled
number_slider_6 = Slider(44, range=0..100)  # disabled
construct_point = ConstructPoint(XCoordinate=number_slider, YCoordinate=number_slider_3, ZCoordinate=number_slider_5)  # disabled
construct_point_2 = ConstructPoint(XCoordinate=number_slider_2, YCoordinate=number_slider_4, ZCoordinate=number_slider_6)  # disabled
number_slider_7 = Slider(4, range=0..10)  # disabled
line = Line(StartPoint=construct_point, EndPoint=construct_point_2)  # disabled
divide_curve = DivideCurve(Curve=line, Count=number_slider_7, Kinks=False)  # -> Points, Tangents, Parameters; disabled
number_slider_8 = Slider(3, range=0..10)  # disabled
number_slider_9 = Slider(5.2, range=0..100)  # disabled
number_slider_10 = Slider(3, range=0..100)  # disabled
number_slider_11 = Slider(4, range=0..100)  # disabled
list_item = ListItem(List=divide_curve.Points, Index=number_slider_8, Wrap=True)  # disabled
center_box = CenterBox(Base=list_item, X=number_slider_9, Y=number_slider_11, Z=number_slider_10)  # disabled

number_slider_12 = Slider(2, range=0..10)  # disabled
number_slider_13 = Slider(6, range=0..10)  # disabled
number_slider_14 = Slider(6, range=0..10)  # disabled
number_slider_15 = Slider(10, range=0..10)  # disabled
center_box_2 = CenterBox(Base=PlaneXY(0, 0, 0), X=number_slider_12, Y=number_slider_12, Z=number_slider_12)  # disabled
number_slider_16 = Slider(200, range=0..1000)  # disabled
box_array = BoxArray(
    Geometry=center_box_2,
    Cell={Plane=PlaneXY(0, 0, 0), X=Domain(0, 10), Y=Domain(0, 5), Z=Domain(0, 2)},
    XCount=number_slider_14,
    YCount=number_slider_13,
    ZCount=number_slider_15)  # -> Geometry, Transform; disabled
list_length = ListLength(List=box_array.Geometry)  # disabled
random_reduce = RandomReduce(List=box_array.Geometry, Reduction=number_slider_16, Seed=1)  # disabled
subtraction = Subtraction(A=list_length, B=number_slider_16)  # disabled
panel = Panel(box_array.Geometry)  # disabled
panel_2 = Panel(subtraction)  # disabled

curve = Curve([<curve referenced from the Rhino model> x15])
unit_z = UnitZ(Factor=Slider(8, range=0..100))
panel_3 = Panel(curve)
number_slider_17 = Slider(5, range=0..10)
number_slider_18 = Slider(30, range=0..100)
random_reduce_2 = RandomReduce(List=flatten(curve), Reduction=number_slider_17, Seed=number_slider_18)
extrude = Extrude(Base=random_reduce_2, Direction=unit_z)
extrude_2 = Extrude(Base=extrude, Direction=unit_z)
move = Move(Geometry=extrude_2, Motion=unit_z)  # -> Geometry, Transform
random_reduce_3 = RandomReduce(List=flatten(move.Geometry), Reduction=Slider(4, range=0..10), Seed=number_slider_18)
merge = Merge(Data1=extrude, Data2=random_reduce_3)

series = Series(Start=Slider(0, range=0..100), Step=Slider(1, range=0..1), Count=Slider(10, range=0..10))
unit_x = UnitX(Factor=series)
unit_y = UnitY(Factor=series)
cross_reference = CrossReference(ListA=unit_x, ListB=unit_y, CrossMode=1)  # -> ListA, ListB
point = Point(Point(0, 0, 0))
addition = Addition(A=cross_reference.ListA, B=cross_reference.ListB)
move_2 = Move(Geometry=point, Motion=addition)  # -> Geometry, Transform

explode = Explode(Curve=random_reduce_2, Recursive=True)  # -> Segments, Vertices
list_item_2 = ListItem(List=explode.Segments, Index=Slider(1, range=0..10), Wrap=True)
list_item_3 = ListItem(List=explode.Segments, Index=Slider(0, range=0..10), Wrap=True)
number_slider_19 = Slider(10, range=0..10)
length = Length(Curve=list_item_3)
length_2 = Length(Curve=list_item_2)
division = Division(A=length, B=number_slider_19)  # -> flatten(Result)
division_2 = Division(A=length_2, B=number_slider_19)  # -> flatten(Result)
number_slider_20 = Slider(3, range=0..10)
mesh_surface = MeshSurface(Surface=random_reduce_2, UCount=division, VCount=division_2, Overhang=True, Equalize=False)

galapagos = Galapagos(fitness=mass_addition, gene=number_slider_17)
area = Area(Geometry=extrude)  # -> Area, Centroid
mass_addition = MassAddition(Input=area.Area)  # -> Result, PartialResults
panel_4 = Panel(mass_addition.Result)
face_boundaries = FaceBoundaries(Mesh=mesh_surface)
unit_z_2 = UnitZ(Factor=1)
extrude_3 = Extrude(Base=face_boundaries, Direction=unit_z_2)
cap_holes = CapHoles(Brep=extrude_3)
